# Grasshopper definition ParametricBlocks.gh (Grasshopper 1.0.7)

pt = Point(<point referenced from the Rhino model>)
circle = CircleCNR(Center=pt, Normal=Vector(0, 0, 1), Radius=Slider(3844, range=0..5000))
number_slider = Slider(2628, range=0..5000)
number_slider_2 = Slider(11, range=0..20)
divide = DivideCurve(Curve=circle, Count=Slider(4, range=0..10), Kinks=False)  # -> Points, Tangents, Parameters
nurbs = NurbsCurve(Vertices=divide.Points, Degree=1, Periodic=True)  # -> Curve, Length, Domain
series = Series(Start=0, Step=number_slider, Count=number_slider_2)
srf = Surface(nurbs.Curve)
Z = UnitZ(Factor=series)
move = Move(Geometry=srf, Motion=Z)  # -> Geometry, Transform
Z_2 = UnitZ(Factor=number_slider)
extr = Extrude(Base=move.Geometry, Direction=Z_2)
series_2 = Series(Start=0, Step=Slider(17, range=0..90), Count=number_slider_2)
area = Area(Geometry=move.Geometry)  # -> Area, Centroid
rad = Radians(Degrees=series_2)
rotate = Rotate(Geometry=extr, Angle=rad, Plane=area.Centroid)  # -> Geometry, Transform
