# Grasshopper definition SDA 002.gh (Grasshopper 1.0.7)

# ----
# Script Name: SDA with Revit Model
# Description: This script allows you to do a spatial daylight autonomy simulation on a Revit model
# GH Plugin Dependencies: Ladybug Tools (Pollination GH) V1.8.0
pr = Panel("00000")
developed_by_contact = Panel("Samreet Singh")
script_version = Panel("1.0.0")
corresponding_rhino_file = Panel("N/A")
project = Panel("Master Script")

# ----
# Create Layers
# Click to Create New Layers
panel = Panel("""Walls
Floors
Ceilings
Roofs
Aperatures
GroundPlane
Context::Simulate
Context::Surplus
GridPlane::KLD
GridPlane::Beds""")
create_layers = Button()
colors = Colors()
createlayer = CreateLayers(full_path=panel, color=colors, run=create_layers)  # -> out, layerName, layerIndex; inputs color: Color, run: Boolean
# ---------- createlayer: Python ----------
"""
This component will create layers in the Rhino Viewport
"""

import Rhino.Geometry as rg
import Rhino.RhinoDoc as rhdoc
import Rhino.DocObjects as docobj
doc = rhdoc.ActiveDoc


ghenv.Component.Name = 'Create Layers'



def _get_layer(layer_name):
    """Get a layer index from the Rhino document from the layer name."""
    layer_table = doc.Layers  # layer table
    layer_index = layer_table.FindByFullPath(layer_name, True)
    combined_part_names = []
    if layer_index < 0:
        
        part_names = layer_name.split("::") #  full name could be layer::sublayer::sublayer

        for i in range(len(part_names)):
            print i
            combined_part_names.append("::".join(part_names[0:i+1])) #  [0] = layer ,  [1] = layer::sublayer, [2] = layer::sublayer::sublayer
            print combined_part_names
            checking_index = layer_table.FindByFullPath(combined_part_names[i], True)
            if  checking_index < 0:  # layer::sublayer doesnt exist:
                print combined_part_names[i] + " was not found"
                
                parent_layer = docobj.Layer()
                parent_layer.Name = part_names[i]
                print combined_part_names[i]
                if i > 0:
                    parent_layer.ParentLayerId = prev_layer.Id # nesting it to previosly created layer
                layer_index = layer_table.Add(parent_layer)
                prev_layer = doc.Layers[layer_index]
            else:
                
                prev_layer = doc.Layers[checking_index]
                
                
                print combined_part_names[-1] + " was found"
    
    if color != None:
        doc.Layers[layer_index].Color = color
    return layer_name, layer_index
    
    
  
if run:
    a = _get_layer(full_path)
    layerName = a[0]
    layerIndex = a[1]
# ---------- end createlayer ----------

external_walls = GeometryPipeline(
    GroupByLayer=False,
    GroupByType=False,
    IncludeHidden=True,
    IncludeLocked=True,
    LayerFilter="ExtWalls",
    NameFilter="*",
    SublayerFiltering=True,
    TypeFilter=1073741848)

panel_2 = Panel("L:\sa.singh\1036138_Broombridge_NewModel\InternalAnalysis\Beds")
panel_3 = Panel("L:\sa.singh\1036138_Broombridge_NewModel\InternalAnalysis\KLD")
recipesettings = HBRecipeSettings(folder=panel_2, reload_old=False)  # -> settings; plug-in component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
recipesettings_2 = HBRecipeSettings(folder=panel_3, reload_old=False)  # -> settings; plug-in component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

# ----
# Set Weather File (APSH)
panel_4 = Panel("https://energyplus-weather.s3.amazonaws.com/europe_wmo_region_6/IRL/IRL_Dublin.039690_IWEC/IRL_Dublin.039690_IWEC.zip")
downloadepw = LBDownloadWeather(weather_URL=panel_4)  # -> epw_file, stat_file, ddy_file; plug-in component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

# ----
# Revit Transparent Geometry
aperatures = GeometryPipeline(
    GroupByLayer=False,
    GroupByType=False,
    IncludeHidden=True,
    IncludeLocked=True,
    LayerFilter="Aperatures",
    NameFilter="*",
    SublayerFiltering=True,
    TypeFilter=1073741848)
glassmod = HBGlassModifier(name="GlassAp", trans=Slider(0.75, range=0..1))  # -> modifier; plug-in component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
aperture = HBAperture(geo=aperatures, rad_mod=glassmod)  # -> report, apertures; plug-in component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

# ----
# Revit Shade Geometry
ground_plane = GeometryPipeline(
    GroupByLayer=False,
    GroupByType=False,
    IncludeHidden=True,
    IncludeLocked=True,
    LayerFilter="GroundPlane",
    NameFilter="*",
    SublayerFiltering=True,
    TypeFilter=1073741848)
neighbouring = GeometryPipeline(
    GroupByLayer=False,
    GroupByType=False,
    IncludeHidden=True,
    IncludeLocked=True,
    LayerFilter="Context::Neighbouring",
    NameFilter="*",
    SublayerFiltering=True,
    TypeFilter=1073741848)
surplus = GeometryPipeline(
    GroupByLayer=False,
    GroupByType=False,
    IncludeHidden=True,
    IncludeLocked=True,
    LayerFilter="Context::Surplus",
    NameFilter="*",
    SublayerFiltering=True,
    TypeFilter=1073741848)
opaquemod = HBOpaqueModifier(name="NeighbouringShade", reflect=Slider(0.5, range=0..1))  # -> modifier; plug-in component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
opaquemod_2 = HBOpaqueModifier(name="SurplusContext", reflect=Slider(0.5, range=0..1))  # -> modifier; plug-in component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
opaquemod_3 = HBOpaqueModifier(name="GroundPlane", reflect=Slider(0.2, range=0..1))  # -> modifier; plug-in component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
shade = HBShade(geo=neighbouring, rad_mod=opaquemod)  # -> report, shades; plug-in component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
shade_2 = HBShade(geo=surplus, rad_mod=opaquemod_2)  # -> report, shades; plug-in component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
shade_3 = HBShade(geo=ground_plane, rad_mod=opaquemod_3)  # -> report, shades; plug-in component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
merge = Merge(Data1=shade_3.shades, Data2=shade_2.shades, Data3=shade.shades)

# ----
# Set Model North
# Preview Model
# Compass
# Point line
# to North
# Set Model North Notes: 1. Right click on 'Line' Component > 'Set One Line' and follow instructions in rhino command line (Above Viewport)
# 
# 2. Preview the Compass component to show what the North looks like for the model
line = Line(Line((713055556.3, 736769757.1, 0), (713055556.3, 736778681.7, 0)))
setnorth = SetNorth(North_Line=line)  # -> North_Vector; inputs North_Line: Line
# ---------- setnorth: Python ----------
"""Creates the north Vector from a line.
    Inputs:
        North_Line: A line pointing in the direction of North
    Output:
        North_Vector: A North vector for the line input"""

__author__ = "sa.singh"
__version__ = "2024.08.12"

import rhinoscriptsyntax as rs
import Rhino

ghenv.Component.Name = 'SetNorth'

if North_Line is not None:
    
    North_Vector = North_Line.Direction
    North_Vector.Unitize()
    start_point = North_Line.From
else:
    North_Vector = Rhino.Geometry.Vector3d(0,1,0)
    start_point = Rhino.Geometry.Point3d(0,0,0)

display_vector = North_Vector * 10000
# ---------- end setnorth ----------
end = EndPoints(Curve=line)  # -> Start, End
compass = LBCompass(north=setnorth, center=end.Start)  # -> compass; plug-in component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

merge_2 = Merge(Data1=ColourSwatch(SwatchColor=RGB(128, 122, 122)), Data2=ColourSwatch(SwatchColor=RGB(135, 222, 109)))
legendpar = LBLegendParameters(seg_count=1, colors=merge_2)  # -> leg_par; plug-in component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

grid_size = Panel("250")
wp_height = Panel("800")
boolean_toggle = BooleanToggle(False)

# ----
# Sensor Grids
kld_grid = GeometryPipeline(
    GroupByLayer=False,
    GroupByType=False,
    IncludeHidden=True,
    IncludeLocked=True,
    LayerFilter="GridPlane::KLD",
    NameFilter="*",
    SublayerFiltering=True,
    TypeFilter=1073741848)
beds_grid = GeometryPipeline(
    GroupByLayer=False,
    GroupByType=False,
    IncludeHidden=True,
    IncludeLocked=True,
    LayerFilter="GridPlane::Beds",
    NameFilter="*",
    SublayerFiltering=True,
    TypeFilter=1073741848)
genpts = LBGeneratePointGrid(geometry=kld_grid, grid_size=grid_size, offset_dist=wp_height, quad_only=boolean_toggle)  # -> points, vectors, face_areas, mesh; plug-in component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
genpts_2 = LBGeneratePointGrid(geometry=beds_grid, grid_size=grid_size, offset_dist=wp_height, quad_only=boolean_toggle)  # -> points, vectors, face_areas, mesh; plug-in component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
sensorgrid = HBSensorGrid(name="KLD", positions=genpts.points, mesh=genpts.mesh)  # -> grid; plug-in component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
sensorgrid_2 = HBSensorGrid(name="beds", positions=genpts_2.points, mesh=genpts_2.mesh)  # -> grid; plug-in component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

opaquemod_4 = HBOpaqueModifier(name="ExternalWalls", reflect=Slider(0.5, range=0..1))  # -> modifier; plug-in component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

# ---- group: APSH
wea = HBWeaFromEPW(epw_file=downloadepw.epw_file)  # -> wea; plug-in component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

# ----
face = HBFace(geo=external_walls, rad_mod=opaquemod_4)  # -> report, faces; plug-in component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

# ----
# Revit Opaque Geometry
internal_walls = GeometryPipeline(
    GroupByLayer=False,
    GroupByType=False,
    IncludeHidden=True,
    IncludeLocked=True,
    LayerFilter="IntWalls",
    NameFilter="*",
    SublayerFiltering=True,
    TypeFilter=1073741848)
floors = GeometryPipeline(
    GroupByLayer=False,
    GroupByType=False,
    IncludeHidden=True,
    IncludeLocked=True,
    LayerFilter="Floors",
    NameFilter="*",
    SublayerFiltering=True,
    TypeFilter=1073741848)
roofs = GeometryPipeline(
    GroupByLayer=False,
    GroupByType=False,
    IncludeHidden=True,
    IncludeLocked=True,
    LayerFilter="Roofs",
    NameFilter="*",
    SublayerFiltering=True,
    TypeFilter=1073741848)
ceilings = GeometryPipeline(
    GroupByLayer=False,
    GroupByType=False,
    IncludeHidden=True,
    IncludeLocked=True,
    LayerFilter="Ceilings",
    NameFilter="*",
    SublayerFiltering=True,
    TypeFilter=1073741848)
frames_sills = GeometryPipeline(
    GroupByLayer=False,
    GroupByType=False,
    IncludeHidden=True,
    IncludeLocked=True,
    LayerFilter="Frames/Sills",
    NameFilter="*",
    SublayerFiltering=True,
    TypeFilter=1073741848)
balcony_soffit = GeometryPipeline(
    GroupByLayer=False,
    GroupByType=False,
    IncludeHidden=True,
    IncludeLocked=True,
    LayerFilter="BalconySoffit",
    NameFilter="*",
    SublayerFiltering=True,
    TypeFilter=1073741848)
balcony_floor = GeometryPipeline(
    GroupByLayer=False,
    GroupByType=False,
    IncludeHidden=True,
    IncludeLocked=True,
    LayerFilter="BalconyFloor",
    NameFilter="*",
    SublayerFiltering=True,
    TypeFilter=1073741848)
opaquemod_5 = HBOpaqueModifier(name="InternalWalls", reflect=Slider(0.7, range=0..1))  # -> modifier; plug-in component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
opaquemod_6 = HBOpaqueModifier(name="Roofs", reflect=Slider(0.5, range=0..1))  # -> modifier; plug-in component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
opaquemod_7 = HBOpaqueModifier(name="Floors", reflect=Slider(0.4, range=0..1))  # -> modifier; plug-in component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
opaquemod_8 = HBOpaqueModifier(name="Frames", reflect=Slider(0.5, range=0..1))  # -> modifier; plug-in component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
opaquemod_9 = HBOpaqueModifier(name="Ceilings", reflect=Slider(0.8, range=0..1))  # -> modifier; plug-in component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
opaquemod_10 = HBOpaqueModifier(name="BalconySoffit", reflect=Slider(0.8, range=0..1))  # -> modifier; plug-in component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
opaquemod_11 = HBOpaqueModifier(name="BalconyFloor", reflect=Slider(0.5, range=0..1))  # -> modifier; plug-in component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
face_2 = HBFace(geo=internal_walls, rad_mod=opaquemod_5)  # -> report, faces; plug-in component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
face_3 = HBFace(geo=roofs, rad_mod=opaquemod_6)  # -> report, faces; plug-in component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
face_4 = HBFace(geo=floors, rad_mod=opaquemod_7)  # -> report, faces; plug-in component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
face_5 = HBFace(geo=frames_sills, rad_mod=opaquemod_8)  # -> report, faces; plug-in component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
face_6 = HBFace(geo=ceilings, rad_mod=opaquemod_9)  # -> report, faces; plug-in component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
face_7 = HBFace(geo=balcony_soffit, rad_mod=opaquemod_10)  # -> report, faces; plug-in component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
face_8 = HBFace(geo=balcony_floor, rad_mod=opaquemod_11)  # -> report, faces; plug-in component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
merge_3 = Merge(
    Data1=face_2.faces,
    Data2=face.faces,
    Data3=face_4.faces,
    Data4=face_6.faces,
    Data5=face_3.faces,
    Data6=face_5.faces,
    Data7=face_7.faces,
    Data8=face_8.faces)

# ---- group: PIT Rad Params
simulation_type = ValueList({"Daylight Factor": 0, "PIT View": 1, "SDA / UDI": 2}, selected="SDA / UDI")
detail_level = ValueList({"Low (Default)": 0, "Medium": 1, "High": 2}, selected="Low (Default)")
ambient_bounces = ValueList({"Direct Sun": 0, "Low": 2, "Medium": 4, "High(Default)": 6, "Very High": 9}, selected="High(Default)")

# ----
update_all_geometry = Button()

# ---- group: Beds Sensors
dam = DataDam(DataA=sensorgrid_2, BufferDelay=10000000, BufferMode=0)

# ---- group: Opaque Geometry
dam_2 = DataDam(DataA=merge_3, BufferDelay=10000000, BufferMode=0)

# ---- group: Shade Geometry
dam_3 = DataDam(DataA=merge, BufferDelay=10000000, BufferMode=0)

# ---- group: Transparent Geometry
dam_4 = DataDam(DataA=aperture.apertures, BufferDelay=10000000, BufferMode=0)

# ---- group: KLD Sensors
dam_5 = DataDam(DataA=sensorgrid, BufferDelay=10000000, BufferMode=0)

# ----
triggr = RemoteDatadamTrigger(groupNames=["Opaque Geometry", "Shade Geometry", "Transparent Geometry", "Sensor Grids"], run=update_all_geometry)  # -> out; inputs groupNames: list of String, run: Boolean
# ---------- triggr: C# usings ----------
using System.Linq;
using System.Drawing;
# ---------- triggr: C# ----------
    Component.Description = "This component will remove trigger datadams.\n\n" +
      "to use it, place your datadams in a group, name the group (right click) and insert the\n" +
      "group name in this component. Hit Run to update all the datadams\n\n" +

      "Copyright LINK Arkitektur 2021 Copenhagen";

    Component.Params.Input[0].Name = "groupNames";
    Component.Params.Input[0].Description = "Names of the groups where we placed the datadams.";
    Component.Params.Input[1].AddVolatileData(new GH_Path(0), 0, false);
    Component.Name = "Remote Datadam Trigger";
    Component.NickName = "TriggR";

    Component.Params.Input[1].Description = "Set to true to run";

    if (run)
    {

      foreach (var groupName in groupNames)
      {
        ExpireDams(groupName);
      }
    }
# ---------- triggr: C# additional code ----------
  void ExpireDams(string groupName){


    var groups = GrasshopperDocument.Objects.OfType<Grasshopper.Kernel.Special.GH_Group>();

    var keyGroup = groups.Where(g => g.NickName == groupName);

    foreach (var myGroup in keyGroup)
    {


      var objects = myGroup.Objects();
      foreach (var obj in objects)
      {
        Grasshopper.Kernel.Components.GH_DataDamComponent myDam = obj as Grasshopper.Kernel.Components.GH_DataDamComponent;
        if (myDam != null)
        {
          myDam.ExpireSolution(true);
          Print("Triggered : " + obj.GetType().ToString());
        }
      }

    }




  }
# ---------- end triggr ----------

# ---- group: PIT Rad Params
# PIT Radiance Parameters
expression = Expression(x=ambient_bounces, Expression="Format(\"-ab {0:0} -ad 5000\", x)")
radpar = HBRadianceParameter(recipe_type=simulation_type, detail_level=detail_level, additional_par=expression)  # -> rad_par; plug-in component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
panel_5 = Panel(radpar)

# ----
model = HBModel(faces=flatten(dam_2), shades=flatten(dam_3), apertures=flatten(dam_4))  # -> report, model; plug-in component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
data = Data([42.99, 46.3, 48.82, 46.96, 48.77, 48.6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])

assigngridsviews = HBAssignGridsAndViews(model=model.model, grids=flatten(dam_5))  # -> model; plug-in component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
annualdaylight = HBAnnualDaylight(
    model=assigngridsviews,
    wea=wea,
    north=setnorth,
    thresholds="-t 300",
    radiance_par="-ab 9 -ad 5000 -as 2048 -lw 6.67e-07",
    run_settings=recipesettings_2,
    run=Toggle(False))  # -> report, results, DA, cDA, UDI, UDI_low, UDI_up; plug-in component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
getgridsviews = HBGetGridsAndViews(model=assigngridsviews)  # -> views, grids, points, meshes; plug-in component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
data_2 = Data(data)

data_3 = Data([90.22, 90.99, 91.26, 91.26, 91.1, 90.9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])

assigngridsviews_2 = HBAssignGridsAndViews(model=model.model, grids=flatten(dam))  # -> model; plug-in component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
annualdaylight_2 = HBAnnualDaylight(
    model=assigngridsviews_2,
    wea=wea,
    north=setnorth,
    thresholds="-t 100",
    radiance_par="-ab 9 -ad 5000 -as 2048 -lw 6.67e-07",
    run_settings=recipesettings,
    run=Toggle(False))  # -> report, results, DA, cDA, UDI, UDI_low, UDI_up; plug-in component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
getgridsviews_2 = HBGetGridsAndViews(model=assigngridsviews_2)  # -> views, grids, points, meshes; plug-in component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
data_4 = Data(data_3)

mjoin = MeshJoin(Meshes=getgridsviews.meshes)
sda = HBSpatialDaylightAutonomy(DA=data_2, mesh=mjoin)  # -> report, sDA, pass_fail; plug-in component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
heatmap = LBSpatialHeatmap(values=sda.pass_fail, mesh=mjoin, legend_par=legendpar)  # -> mesh, legend, title, colors, legend_par, vis_set; plug-in component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

mjoin_2 = MeshJoin(Meshes=getgridsviews_2.meshes)
sda_2 = HBSpatialDaylightAutonomy(DA=data_4, mesh=mjoin_2)  # -> report, sDA, pass_fail; plug-in component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
heatmap_2 = LBSpatialHeatmap(values=sda_2.pass_fail, mesh=mjoin_2, legend_par=legendpar)  # -> mesh, legend, title, colors, legend_par, vis_set; plug-in component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

area = Area(Geometry=getgridsviews.meshes)  # -> Area, Centroid
area_2 = Area(Geometry=getgridsviews_2.meshes)  # -> Area, Centroid
swatch = ColourSwatch(SwatchColor=RGB(0, 0, 0))

mjoin_3 = MeshJoin(Meshes=getgridsviews.meshes)
facen = FaceNormals(Mesh=getgridsviews.meshes)  # -> Centers, Normals
mesh_explode = MeshExplode(m=mjoin_3)  # -> out, simplify(A)
# ---------- mesh_explode: VB usings ----------
Imports System.IO
Imports System.Linq
Imports System.Data
Imports System.Drawing
Imports System.Reflection
Imports System.Windows.Forms
Imports System.Xml
Imports System.Xml.Linq
Imports Microsoft.VisualBasic
Imports System.Runtime.InteropServices

Imports Rhino.DocObjects
Imports Rhino.Collections
Imports GH_IO
Imports GH_IO.Serialization
# ---------- mesh_explode: VB ----------
    Component.Params.Input(0).Name = "Mesh"
    Component.Params.Input(0).Description = "Open or closed mesh"

    Component.Params.Output(1).Name = "Mesh"
    Component.Params.Output(1).Description = "If successful, a valid mesh"

    If m IsNot Nothing Then
      Dim pts As Rhino.Geometry.Collections.MeshVertexList
      Dim faces As Rhino.Geometry.Collections.MeshFaceList
      Dim clrs As Rhino.Geometry.Collections.MeshVertexColorList
      Dim i As Integer
      Dim mshs As New list(Of mesh)

      faces = m.Faces
      pts = m.Vertices
      If m.VertexColors.count() = 0 Then m.VertexColors.CreateMonotoneMesh(color.FromArgb(100, 100, 100))
      clrs = m.VertexColors

      For i = 0 To faces.count() - 1 Step 1
        Dim fc As New meshFace
        Dim face As New MeshFace
        Dim ptList As New list(Of point3d)
        Dim clrList As New list(Of color)
        Dim msh As New mesh

        face = faces(i)

        ptList.add(New point3d(pts(face.A)))
        ptList.add(New point3d(pts(face.B)))
        ptList.add(New point3d(pts(face.C)))
        If face.IsQuad Then ptList.add(New point3d(pts(face.D)))

        clrList.add(clrs(face.A))
        clrList.add(clrs(face.B))
        clrList.add(clrs(face.C))
        If face.IsQuad Then clrList.add(clrs(face.D))

        If face.IsQuad Then fc = New meshFace(0, 1, 2, 3) Else fc = New meshface(0, 1, 2)

        msh.Vertices.AddVertices(ptList.toarray())
        msh.Faces.AddFace(fc)
        msh.VertexColors.SetColors(clrList.toarray())
        mshs.add(msh)
      Next

      A = mshs
    End If
# ---------- end mesh_explode ----------
unflatten = UnflattenTree(Tree=data_2, Guide=facen.Centers)
unflatten_2 = UnflattenTree(Tree=mesh_explode.A, Guide=facen.Centers)
larger = LargerThan(FirstNumber=unflatten, SecondNumber="50")  # -> LargerThan, OrEqualTo
cull = CullPattern(List=unflatten_2, CullPattern=larger.OrEqualTo)
Z = UnitZ(Factor="1.1")
move = Move(Geometry=area.Centroid, Motion=Z)  # -> Geometry, Transform

area_3 = Area(Geometry=unflatten_2)  # -> Area, Centroid
area_4 = Area(Geometry=cull)  # -> Area, Centroid

ma = MassAddition(Input=area_3.Area)  # -> Result, PartialResults
ma_2 = MassAddition(Input=area_4.Area)  # -> Result, PartialResults
nullrep = ReplaceNulls(Items=ma_2.Result, Replacements=1)  # -> Items, Count
expression_2 = Expression(x=nullrep.Items, y=ma.Result, Expression="Format(\"{0:0.0}%\", (x/y)*100)")  # -> flatten(R)

sda_3 = TextTag(Location=move.Geometry, Text=expression_2, Colour=swatch)
contours = CustomPreview(
    Geometry=heatmap.mesh,
    Material={diffuse=RGB(221, 160, 221), emission=RGB(66, 48, 66), shine=0.5, specular=RGB(255, 255, 255), transparency=0})

mjoin_4 = MeshJoin(Meshes=getgridsviews_2.meshes)
facen_2 = FaceNormals(Mesh=getgridsviews_2.meshes)  # -> Centers, Normals
mesh_explode_2 = MeshExplode(m=mjoin_4)  # -> out, simplify(A); same code as mesh_explode
unflatten_3 = UnflattenTree(Tree=data_4, Guide=facen_2.Centers)
unflatten_4 = UnflattenTree(Tree=mesh_explode_2.A, Guide=facen_2.Centers)
larger_2 = LargerThan(FirstNumber=unflatten_3, SecondNumber="50")  # -> LargerThan, OrEqualTo
cull_2 = CullPattern(List=unflatten_4, CullPattern=larger_2.OrEqualTo)
Z_2 = UnitZ(Factor="1.1")
move_2 = Move(Geometry=area_2.Centroid, Motion=Z_2)  # -> Geometry, Transform

area_5 = Area(Geometry=unflatten_4)  # -> Area, Centroid
area_6 = Area(Geometry=cull_2)  # -> Area, Centroid

ma_3 = MassAddition(Input=area_5.Area)  # -> Result, PartialResults
ma_4 = MassAddition(Input=area_6.Area)  # -> Result, PartialResults
nullrep_2 = ReplaceNulls(Items=ma_4.Result, Replacements=1)  # -> Items, Count
expression_3 = Expression(x=nullrep_2.Items, y=ma_3.Result, Expression="Format(\"{0:0.0}%\", (x/y)*100)")  # -> flatten(R)

sda_4 = TextTag(Location=move_2.Geometry, Text=expression_3, Colour=swatch)
contours_2 = CustomPreview(
    Geometry=heatmap_2.mesh,
    Material={diffuse=RGB(221, 160, 221), emission=RGB(66, 48, 66), shine=0.5, specular=RGB(255, 255, 255), transparency=0})

merge_4 = Merge(Data1=expression_2, Data2=expression_3)
merge_5 = Merge(Data1=move.Geometry, Data2=move_2.Geometry)
tag = TextTag3D(Location=merge_5, Text=merge_4, Size="500", Colour=swatch, Justification=5)

# ==== cluster Colors
merge = Merge(
    Data1=ColourSwatch(SwatchColor=RGB(84, 24, 62)),
    Data2=ColourSwatch(SwatchColor=RGB(255, 20, 169)),
    Data3=ColourSwatch(SwatchColor=RGB(54, 135, 86)),
    Data4=ColourSwatch(SwatchColor=RGB(148, 113, 106)),
    Data5=ColourSwatch(SwatchColor=RGB(178, 70, 48)),
    Data6=ColourSwatch(SwatchColor=RGB(235, 185, 94)),
    Data7=ColourSwatch(SwatchColor=RGB(216, 235, 94)),
    Data8=ColourSwatch(SwatchColor=RGB(87, 189, 90)),
    Data9=ColourSwatch(SwatchColor=RGB(105, 125, 84)),
    Data10=ColourSwatch(SwatchColor=RGB(92, 169, 181)),
    Data11=ColourSwatch(SwatchColor=RGB(166, 181, 92)),
    Data12=ColourSwatch(SwatchColor=RGB(137, 92, 181)),
    Data13=ColourSwatch(SwatchColor=RGB(67, 108, 115)),
    Data14=ColourSwatch(SwatchColor=RGB(186, 112, 97)),
    Data15=ColourSwatch(SwatchColor=RGB(92, 94, 181)))
R = ClusterOutput(merge)
