# Grasshopper definition UsefulComponents.gh (Grasshopper 1.0.7)

# <-- Each color swatch
# will be applied to the
# corresponding new layer
click_to_create_layers = Button()

# ----
# Create Layers
# ^Click this button to
# Create Layers
panel = Panel("""Gabriela
Ishita
Samreet::sublayer1
Samreet::sublayer2""")
# <-- Enter layer names to be created.
# To create sublayers use '::'
merge = Merge(
    Data1=ColourSwatch(SwatchColor=RGB(84, 24, 62)),
    Data2=ColourSwatch(SwatchColor=RGB(255, 20, 169)),
    Data3=ColourSwatch(SwatchColor=RGB(54, 135, 86)),
    Data4=ColourSwatch(SwatchColor=RGB(148, 113, 106)),
    Data5=ColourSwatch(SwatchColor=RGB(178, 70, 48)),
    Data6=ColourSwatch(SwatchColor=RGB(235, 185, 94)),
    Data7=ColourSwatch(SwatchColor=RGB(216, 235, 94)),
    Data8=ColourSwatch(SwatchColor=RGB(87, 189, 90)),
    Data9=ColourSwatch(SwatchColor=RGB(105, 125, 84)),
    Data10=ColourSwatch(SwatchColor=RGB(92, 169, 181)),
    Data11=ColourSwatch(SwatchColor=RGB(166, 181, 92)),
    Data12=ColourSwatch(SwatchColor=RGB(137, 92, 181)),
    Data13=ColourSwatch(SwatchColor=RGB(92, 169, 181)))
createlayer = CreateLayers(full_path=panel, color=merge, run=click_to_create_layers)  # -> out, layerName, layerIndex; inputs color: Color, run: Boolean
# ---------- createlayer: Python ----------
"""
This component will create layers in the Rhino Viewport
"""

import Rhino.Geometry as rg
import Rhino.RhinoDoc as rhdoc
import Rhino.DocObjects as docobj
doc = rhdoc.ActiveDoc


ghenv.Component.Name = 'Create Layers'



def _get_layer(layer_name):
    """Get a layer index from the Rhino document from the layer name."""
    layer_table = doc.Layers  # layer table
    layer_index = layer_table.FindByFullPath(layer_name, True)
    combined_part_names = []
    if layer_index < 0:
        
        part_names = layer_name.split("::") #  full name could be layer::sublayer::sublayer

        for i in range(len(part_names)):
            print i
            combined_part_names.append("::".join(part_names[0:i+1])) #  [0] = layer ,  [1] = layer::sublayer, [2] = layer::sublayer::sublayer
            print combined_part_names
            checking_index = layer_table.FindByFullPath(combined_part_names[i], True)
            if  checking_index < 0:  # layer::sublayer doesnt exist:
                print combined_part_names[i] + " was not found"
                
                parent_layer = docobj.Layer()
                parent_layer.Name = part_names[i]
                print combined_part_names[i]
                if i > 0:
                    parent_layer.ParentLayerId = prev_layer.Id # nesting it to previosly created layer
                layer_index = layer_table.Add(parent_layer)
                prev_layer = doc.Layers[layer_index]
            else:
                
                prev_layer = doc.Layers[checking_index]
                
                
                print combined_part_names[-1] + " was found"
    
    if color != None:
        doc.Layers[layer_index].Color = color
    return layer_name, layer_index
    
    
  
if run:
    a = _get_layer(full_path)
    layerName = a[0]
    layerIndex = a[1]
# ---------- end createlayer ----------

# ----
# Geometry Pipeline
# Useful for getting geometry from layers automatically
# 1. Create any geometry in Rhino (line, box, etc.)
# 2. ^Right-click on component > 'Layer Filter' > Type in layer name to get geometry from layer
# 
# (it is case sensitive)
# 3. ^Right-click on component > Click Points/curves/breps/meshes to choose what geometry type to filter for.
# 
# (You can choose multiple types at once)
# Note 1: Don't change 'Name Filter'
# Note 2: Use star symbol * in 'Layer Filter' if you want to choose all layers
pipeline = GeometryPipeline(
    GroupByLayer=False,
    GroupByType=False,
    IncludeHidden=True,
    IncludeLocked=True,
    LayerFilter="*",
    NameFilter="*",
    SublayerFiltering=True,
    TypeFilter=0)
geo = Geometry(pipeline)
panel_2 = Panel(geo)

# ----
# Data Dam Trigger
# Click this button to
# remotely refresh both
# data dams above together.
# 
# (Change number slider above first)
update_both_dams_above = Button()
triggr = RemoteDatadamTrigger(groupNames=["dam1", "dam2"], run=update_both_dams_above)  # -> out; inputs groupNames: list of String, run: Boolean
# ---------- triggr: C# usings ----------
using System.Linq;
using System.Drawing;
# ---------- triggr: C# ----------
    Component.Description = "This component will remove trigger datadams.\n\n" +
      "to use it, place your datadams in a group, name the group (right click) and insert the\n" +
      "group name in this component. Hit Run to update all the datadams\n\n" +

      "Copyright LINK Arkitektur 2021 Copenhagen";

    Component.Params.Input[0].Name = "groupNames";
    Component.Params.Input[0].Description = "Names of the groups where we placed the datadams.";
    Component.Params.Input[1].AddVolatileData(new GH_Path(0), 0, false);
    Component.Name = "Remote Datadam Trigger";
    Component.NickName = "TriggR";

    Component.Params.Input[1].Description = "Set to true to run";

    if (run)
    {

      foreach (var groupName in groupNames)
      {
        ExpireDams(groupName);
      }
    }
# ---------- triggr: C# additional code ----------
  void ExpireDams(string groupName){


    var groups = GrasshopperDocument.Objects.OfType<Grasshopper.Kernel.Special.GH_Group>();

    var keyGroup = groups.Where(g => g.NickName == groupName);

    foreach (var myGroup in keyGroup)
    {


      var objects = myGroup.Objects();
      foreach (var obj in objects)
      {
        Grasshopper.Kernel.Components.GH_DataDamComponent myDam = obj as Grasshopper.Kernel.Components.GH_DataDamComponent;
        if (myDam != null)
        {
          myDam.ExpireSolution(true);
          Print("Triggered : " + obj.GetType().ToString());
        }
      }

    }




  }
# ---------- end triggr ----------

# ----
# Stream Filter
# Click Arrows to change ^
# which input gets passed
# into the output side
# Filter is useful to allow
# user to choose which
# inputs to pass through
choose_input = ValueList({"Slider 1": 0, "Slider 2": 1}, selected="Slider 1")
value = Slider(3, range=1..10)
value_2 = Slider(10, range=1..10)
filter = StreamFilter(Gate=choose_input, Stream0=value, Stream1=value_2)
panel_3 = Panel(filter)

# ----
# Stream Gate
# Gate can allow user to
# select where the input
# data gets outputted to.
# Click Arrows to change ^
# where the input 'Value'
# gets outputted to
choose_output = ValueList({"Panel 1": 0, "Panel 2": 1, "Panel 3": 2}, selected="Panel 1")
value_3 = Slider(7, range=1..10)
gate = StreamGate(Stream=value_3, Gate=choose_output)  # -> Target0, Target1, Target2
panel_4 = Panel(gate.Target0)

panel_5 = Panel(gate.Target2)
panel_6 = Panel(gate.Target1)

# ----
# Grasshopper Data Viewer
# 1. Go to View > Data Viewer.
# (Beside 'File' on top left of Screen)
# 2. Click the 'Auto Update' Icon
# (Green Circle Arrows)
# 3. Click on these data components
# one-by-one to view the data inside
# Data Viewer is a faster alternative to the 'Panel' component to quickly view data inside objects.
# Useful when trying to resolve issues
image = ImageSampler(
    FilePath="C:\Users\sa.singh\OneDrive - Cundall\Documents\My Pictures\Screenshots\Screenshot 2024-08-28 090259.png",
    Filter="Colour",
    Interpolate=False,
    Umax=1,
    Umin=0,
    Vmax=1,
    Vmin=0,
    Wrap=1)
image_2 = ImageSampler(
    FilePath="C:\Users\sa.singh\OneDrive - Cundall\Documents\My Pictures\Screenshots\Screenshot 2024-08-28 090537.png",
    Filter="Colour",
    Interpolate=False,
    Umax=1,
    Umin=0,
    Vmax=1,
    Vmin=0,
    Wrap=1)
points_data = Point([Point(-572.0442803, -357.3382122, 0), Point(-414.1479409, -220.4100988, 0), Point(-369.4195949, 24.53780179, 0), Point(-254.8248706, 154.9252634, 0), Point(-449.3847923, 434.3693028, 0), Point(-132.166249, 265.5552759, 0)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])
text_data = Data("Hello to whoever is viewing this data!")
list_data = Data(["21", "7", "15", "8", "9"])

# ----
# Data Dam
# Data dams will not
# change the input
# unless it is refreshed.
# ^Change Number on slider
# ^Click Arrow to refresh each
# Data Dam and watch the
# number in the panel change
number_slider = Slider(8, range=1..10)

# ---- group: dam1
dam = DataDam(DataA=number_slider, BufferDelay=10000000, BufferMode=0)

# ---- group: dam2
dam_2 = DataDam(DataA=number_slider, BufferDelay=10000000, BufferMode=0)

# ----
panel_7 = Panel(dam)
panel_8 = Panel(dam_2)
