# Grasshopper definition VSC_APSH.gh (Grasshopper 1.0.7)
# plug-ins: LadybugGrasshopper

# ----
# Script Name: VSC, APSH and PIT Render
# Description: This script allows you to do a Vertical Sky Component & Annual Probable Sunlight Hours along with hemispherical renderings of views out from chosen window positions
# GH Plugin Dependencies: Ladybug Tools (Pollination GH) V1.8.0
pr = Panel("00000")
developed_by_contact = Panel("Samreet Singh")
script_version = Panel("1.0.0")
corresponding_rhino_file = Panel("N/A")
project = Panel("Master Script")

simulation_type = ValueList({"VSC": 0, "PIT View": 1, "Annual Sim": 2}, selected="PIT View")
detail_level = ValueList({"Low (Default)": 0, "Medium": 1, "High": 2}, selected="Low (Default)")
ambient_bounces = ValueList({"Direct Sun Only": 0, "Sky only": 1, "Low (Default)": 2, "Medium": 4, "High": 6, "Very High": 9}, selected="Low (Default)")

# ----
# Set Weather File (APSH)
panel = Panel("https://energyplus-weather.s3.amazonaws.com/europe_wmo_region_6/IRL/IRL_Dublin.039690_IWEC/IRL_Dublin.039690_IWEC.zip")
downloadepw = LBDownloadWeather(weather_URL=panel)  # -> epw_file, stat_file, ddy_file; plug-in component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
analysisperiod = LBAnalysisPeriod(
    start_month=Slider(9, range=1..12),
    start_day=Slider(21, range=1..31),
    start_hour=Slider(0, range=0..23),
    end_month=Slider(3, range=1..12),
    end_day=Slider(21, range=1..31),
    end_hour=Slider(23, range=0..23))  # -> period, hoys, dates; plug-in component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

# ----
# Render a Point-In-Time Image
# Choose Model to Render
render_model = ValueList({"Baseline (Existing)": 0, "Proposed": 1, "No Rendering": 2}, selected="No Rendering")
grpcol = GhPythonScript(Simtype=render_model)  # -> out, a; inputs Simtype: Int32
# ---------- grpcol: Python ----------
__author__ = "sa.singh"
__version__ = "2024.08.24"

import rhinoscriptsyntax as rs
import System.Drawing as drawing
from Grasshopper.Kernel import GH_ActiveObject
from Grasshopper.Kernel.Special import GH_Group

def find_group_by_name(doc, name):
    """Helper function to find a group by name"""
    for obj in doc.Objects:
        if isinstance(obj, GH_Group) and obj.NickName == name:
            return obj
    return None

def RunScript(inpgroups, ppgroups,Simtype):
    processing_colour = drawing.Color.FromArgb(204,203,171)
    input_colour = drawing.Color.FromArgb(67,204,222)
    postprocess_colour = drawing.Color.FromArgb(148,214,94)
    
    doc = ghenv.Component.OnPingDocument()
    
    if Simtype ==2:
        for inpgroup in inpgroups:
            gr = find_group_by_name(doc,inpgroup)
            gr.Colour = drawing.Color.FromArgb(56,56,56)
        for ppgroup in ppgroups:
            gr = find_group_by_name(doc,ppgroup)
            gr.Colour = drawing.Color.FromArgb(56,56,56)
    else:
        for inpgroup in inpgroups:
            gr = find_group_by_name(doc,inpgroup)
            gr.Colour = input_colour
        for ppgroup in ppgroups:
            gr = find_group_by_name(doc,ppgroup)
            gr.Colour = postprocess_colour



inputsg = ['PIT View', 'PIT Rad Params']
postprog = ['PIT Image']
RunScript(inputsg, postprog, Simtype)
# ---------- end grpcol ----------

simulation_type_2 = ValueList({"VSC": 0, "PIT View": 1, "Annual Sim": 2}, selected="VSC")
detail_level_2 = ValueList({"Low": 0, "Medium": 1, "High (Default)": 2}, selected="High (Default)")

# ----
# Set Simulation Paths
python_autogenerate_filepath = GhPythonScript()  # -> out, VSC_Baseline, VSC_Proposed, VSC_Images, VSC_CSV, PIT_Render, APSH_Probable, APSH_Existing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
# ---------- python_autogenerate_filepath: Python ----------
__author__ = "sa.singh"
__version__ = "2024.09.09"

import rhinoscriptsyntax as rs


Res_Path = "\\".join(ghdoc.Path.split("\\")[:-1])

VSC_Baseline = Res_Path + '\\VSC_Simulation\\Baseline'
VSC_Proposed = Res_Path + '\\VSC_Simulation\\Proposed'
VSC_Images = Res_Path + '\\VSC_Simulation\\Images'
VSC_CSV = Res_Path + '\\VSC_Simulation\\CSV'
PIT_Render = Res_Path + '\\PIT_Render'
APSH_Probable = Res_Path + '\\APSH\\Probable'
APSH_Existing = Res_Path + '\\APSH\\Existing'
APSH_Proposed = Res_Path + '\\APSH\\Proposed'
WPSH_Probable = Res_Path + '\\WPSH\\Probable'
WPSH_Existing = Res_Path + '\\WPSH\\Existing'
WPSH_Proposed = Res_Path + '\\WPSH\\Proposed'
# ---------- end python_autogenerate_filepath ----------
edit_cluster_for_manual_filepath = EditClusterForManualFilepath(
    folder=python_autogenerate_filepath.VSC_Baseline,
    folder_3=python_autogenerate_filepath.VSC_Proposed,
    folder_2=python_autogenerate_filepath.PIT_Render,
    folder_4=python_autogenerate_filepath.APSH_Probable,
    folder_5=python_autogenerate_filepath.APSH_Existing,
    folder_6=python_autogenerate_filepath.APSH_Proposed,
    folder_7=python_autogenerate_filepath.WPSH_Probable,
    folder_8=python_autogenerate_filepath.WPSH_Existing,
    folder_9=python_autogenerate_filepath.WPSH_Proposed)  # -> settings, settings_2, settings_3, settings_4, settings_5, settings_6, settings_7, settings_8, settings_9

# ----
# Set Model North (For APSH Only)
# Preview Model
# Compass
# Point line
# to North
# Set Model North Notes: 1. Right click on 'Line' Component > 'Set One Line' and follow instructions in rhino command line (Above Viewport)
# 
# 2. Preview the Compass component to show what the North looks like for the model
line = Line(Line((9456.136605, 11139.17173, 0), (9456.136605, 2147.853092, 0)))
setnorth = SetNorth(North_Line=line)  # -> North_Vector; inputs North_Line: Line
# ---------- setnorth: Python ----------
"""Creates the north Vector from a line.
    Inputs:
        North_Line: A line pointing in the direction of North
    Output:
        North_Vector: A North vector for the line input"""

__author__ = "sa.singh"
__version__ = "2024.08.12"

import rhinoscriptsyntax as rs
import Rhino

ghenv.Component.Name = 'SetNorth'

if North_Line is not None:
    
    North_Vector = North_Line.Direction
    North_Vector.Unitize()
    start_point = North_Line.From
else:
    North_Vector = Rhino.Geometry.Vector3d(0,1,0)
    start_point = Rhino.Geometry.Point3d(0,0,0)

display_vector = North_Vector * 10000
# ---------- end setnorth ----------
end = EndPoints(Curve=line)  # -> Start, End
compass = LBCompass(north=setnorth, center=end.Start)  # -> compass; plug-in component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

neighbouring_geometry = GeometryPipeline(
    GroupByLayer=False,
    GroupByType=False,
    IncludeHidden=True,
    IncludeLocked=True,
    LayerFilter="Neighbouring::VSC",
    NameFilter="*",
    SublayerFiltering=True,
    TypeFilter=1073741848)
baseline_geometry = GeometryPipeline(
    GroupByLayer=False,
    GroupByType=False,
    IncludeHidden=True,
    IncludeLocked=True,
    LayerFilter="BaselineSite::VSC",
    NameFilter="*",
    SublayerFiltering=True,
    TypeFilter=1073741848)
proposed_geometry = GeometryPipeline(
    GroupByLayer=False,
    GroupByType=False,
    IncludeHidden=True,
    IncludeLocked=True,
    LayerFilter="ProposedSite::VSC_Model_1",
    NameFilter="*",
    SublayerFiltering=True,
    TypeFilter=1073741848)
ground_plane = GeometryPipeline(
    GroupByLayer=False,
    GroupByType=False,
    IncludeHidden=True,
    IncludeLocked=True,
    LayerFilter="GroundPlane(APSH)",
    NameFilter="*",
    SublayerFiltering=True,
    TypeFilter=1073741848)
# VSC analysis uses geometry in both 'ForVSC' and 'ForAPSH' Layer
vsc_windows = GeometryPipeline(
    GroupByLayer=False,
    GroupByType=False,
    IncludeHidden=True,
    IncludeLocked=True,
    LayerFilter="Windows::ForVSC",
    NameFilter="*",
    SublayerFiltering=True,
    TypeFilter=1073741848)
# APSH Analysis only uses window geometry in 'ForAPSH' Layer
apsh_windows = GeometryPipeline(
    GroupByLayer=False,
    GroupByType=False,
    IncludeHidden=True,
    IncludeLocked=True,
    LayerFilter="Windows::ForAPSH",
    NameFilter="*",
    SublayerFiltering=True,
    TypeFilter=1073741848)

# ---- group: PIT View
base_of_vector = Point(Point(-3185.127903, 3408.863941, 3861.867549))
tip_of_vector = Point(Point(-3185.127903, 4409.035339, 3861.867549))
view_base_position = Point(Point(-3185.127903, 3493.364985, 3861.867549))

# PIT Image Position
# PIT Image Position Notes: 1. For this to work draw a 'Line: Normal to Surface' (More options under line icon in Rhino Viewport). Draw base at surface of Window, and tip ~1m perpendicular to window surface.
# 
# 2. 'View Base Position': Right click component> 'Set one point'. Choose point just before base of line.
# 
# 3. Base and Tip of Vector are Base (next to window surface) and Tip (line point away from window) of the line drawn.
viewtype = ValueList({"* 0 Perspective (v)": 0, "* 1 Hemispherical fisheye (h)": 1, "* 2 Parallel (l)": 2, "* 3 Cylindrical panorama (c)": 3, "* 4 Angular fisheye (a)": 4, "* 5 Planisphere [stereographic] (s)": 5}, selected="* 1 Hemispherical fisheye (h)")
vec2pt = Vector2Pt(PointA=base_of_vector, PointB=tip_of_vector, Unitize=False)  # -> Vector, Length
view = HBView(position=view_base_position, direction=vec2pt.Vector, view_type=viewtype, h_angle="180", v_angle="180")  # -> view; plug-in component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

# ----
# Click to Create New Layers
create_layers = Button()

# ---- group: PIT Rad Params
# PIT Radiance Parameters
# Radiance Parameter Notes: 1. Please leave Simulation type to: PIT View
# 
# 2. Increasing Detail Level/ Ambient Bounces will increase run time.
# 
# 3. Ambient bounces allow option for simulation with sun only (no reflected light). Higher AB will increase reflected light. E.g) Slightly increase light in dark spots/corners
expression = Expression(x=ambient_bounces, Expression="Format(\"-ab {0:0}\", x)")
radpar = HBRadianceParameter(recipe_type=simulation_type, detail_level=detail_level, additional_par=expression)  # -> rad_par; plug-in component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
panel_2 = Panel(radpar)

# ----
# VSC Radiance Parameters
radpar_2 = HBRadianceParameter(recipe_type=simulation_type_2, detail_level=detail_level_2, additional_par="-u")  # -> rad_par; plug-in component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
panel_3 = Panel(radpar_2)

colors = Colors()

# ----
# Note: Save This File Before Starting
# Create Layers
# Create Layer Notes: 1. Layers written in Panel (top left) will be automatically created in Rhino. Coloured by the corresponding Swatches
# 
# 2. You can change layers to suite you as needed. Note; double colon (::) means sublayer
panel_4 = Panel("""Neighbouring::VSC
Neighbouring::Trees
Neighbouring::Surplus
BaselineSite::VSC
BaselineSite::Trees
BaselineSite::Surplus
ProposedSite::VSC_Model_1
ProposedSite::Trees
Windows::ForVSC
Windows::ForAPSH
GroundPlane(APSH)""")
createlayer = CreateLayers(full_path=panel_4, color=colors, run=create_layers)  # -> out, layerName, layerIndex; inputs color: Color, run: Boolean
# ---------- createlayer: Python ----------
"""
This component will create layers in the Rhino Viewport
"""

import Rhino.Geometry as rg
import Rhino.RhinoDoc as rhdoc
import Rhino.DocObjects as docobj
doc = rhdoc.ActiveDoc


ghenv.Component.Name = 'Create Layers'



def _get_layer(layer_name):
    """Get a layer index from the Rhino document from the layer name."""
    layer_table = doc.Layers  # layer table
    layer_index = layer_table.FindByFullPath(layer_name, True)
    combined_part_names = []
    if layer_index < 0:
        
        part_names = layer_name.split("::") #  full name could be layer::sublayer::sublayer

        for i in range(len(part_names)):
            print i
            combined_part_names.append("::".join(part_names[0:i+1])) #  [0] = layer ,  [1] = layer::sublayer, [2] = layer::sublayer::sublayer
            print combined_part_names
            checking_index = layer_table.FindByFullPath(combined_part_names[i], True)
            if  checking_index < 0:  # layer::sublayer doesnt exist:
                print combined_part_names[i] + " was not found"
                
                parent_layer = docobj.Layer()
                parent_layer.Name = part_names[i]
                print combined_part_names[i]
                if i > 0:
                    parent_layer.ParentLayerId = prev_layer.Id # nesting it to previosly created layer
                layer_index = layer_table.Add(parent_layer)
                prev_layer = doc.Layers[layer_index]
            else:
                
                prev_layer = doc.Layers[checking_index]
                
                
                print combined_part_names[-1] + " was found"
    
    if color != None:
        doc.Layers[layer_index].Color = color
    return layer_name, layer_index
    
    
  
if run:
    a = _get_layer(full_path)
    layerName = a[0]
    layerIndex = a[1]
# ---------- end createlayer ----------

update_all_geometry = Button()

# ---- group: Proposed Geometry
dam = DataDam(DataProposed=[proposed_geometry, neighbouring_geometry], BufferDelay=10000000, BufferMode=0)

# ---- group: VSC Windows
dam_2 = DataDam(DataWindows=[vsc_windows, apsh_windows], BufferDelay=10000000, BufferMode=0)

# ---- group: APSH Windows
dam_3 = DataDam(DataWindows=apsh_windows, BufferDelay=10000000, BufferMode=0)

# ---- group: Baseline Geometry
dam_4 = DataDam(DataBaseline=[neighbouring_geometry, baseline_geometry], BufferDelay=10000000, BufferMode=0)

# ----
# Input Geometries
# Choose Geometry to Simulate
# 1
# 2
# Input Geometry Notes: 1. Choose Geometry to Simulate
# 
# 2. To edit layers: Right click on pipeline component>Layer Filter, to choose selection layer. Note; double colon (::) means sublayer
# 
# 3. Update Datadams if the geometry has changed
geometry_to_simulate = ValueList({"Baseline (Existing)": 0, "Proposed": 1, "Both Models": 2}, selected="Both Models")
grpcol_2 = GhPythonScript(Simtype=geometry_to_simulate)  # inputs Simtype: Int32
# ---------- grpcol_2: Python ----------
__author__ = "sa.singh"
__version__ = "2024.08.24"

import rhinoscriptsyntax as rs
import System.Drawing as drawing
from Grasshopper.Kernel import GH_ActiveObject
from Grasshopper.Kernel.Special import GH_Group

def find_group_by_name(doc, name):
    """Helper function to find a group by name"""
    for obj in doc.Objects:
        if isinstance(obj, GH_Group) and obj.NickName == name:
            return obj
    return None

def RunScript(Simtype):
    processing_colour = drawing.Color.FromArgb(255,255,214)
    input_colour = drawing.Color.FromArgb(67,204,222)
    postprocess_colour = drawing.Color.FromArgb(148,214,94)
    
    doc = ghenv.Component.OnPingDocument()
    
    prop = find_group_by_name(doc,'Proposed Model')
    base = find_group_by_name(doc,'Baseline Model')
    
    if Simtype == 0: # Baseline model
        prop.Colour = drawing.Color.FromArgb(56,56,56)
        base.Colour = processing_colour
    elif Simtype == 1: # Proposed model
        prop.Colour = processing_colour
        base.Colour = drawing.Color.FromArgb(56,56,56)
    else:
        prop.Colour = processing_colour
        base.Colour = processing_colour


RunScript(Simtype)
# ---------- end grpcol_2 ----------
logic_filt = StreamFilter(Gate=geometry_to_simulate, Stream0=dam_4, Stream2=dam_4)
logic_filt_2 = StreamFilter(Gate=geometry_to_simulate, Stream1=dam, Stream2=dam)

# ---- group: Ground Plane (APSH)
dam_5 = DataDam(DataGround=ground_plane, BufferDelay=10000000, BufferMode=0)

# ---- group: APSH
wea = HBWeaFromEPW(epw_file=downloadepw.epw_file)  # -> wea; plug-in component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

# ---- group: WPSH
wea_2 = HBWeaFromEPW(epw_file=downloadepw.epw_file, hoys=analysisperiod.hoys)  # -> wea; plug-in component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

# ----
# Preview: Select
# Geometry and
# Turn on Preview
geometry = ValueList({"Baseline": 0, "Proposed": 1, "VSC Windows": 2, "APSH Windows": 3, "Ground (APSH)": 4}, selected="Ground (APSH)")
filter = StreamFilter(Gate=geometry, Stream0=dam_4, Stream1=dam, Stream2=dam_2, Stream3=dam_3, Stream4=dam_5)
preview = CustomPreview(Geometry=filter, Material=ColourSwatch(SwatchColor=RGB(250, 52, 52)))

# ---- group: Baseline Model
shade = HBShade(geo=logic_filt)  # -> report, shades; plug-in component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
# HB Model, VSC Sensors and PIT View
model = HBModel(shades=flatten(shade.shades), name="Baseline")  # -> report, model; plug-in component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

# ---- group: Proposed Model
shade_2 = HBShade(geo=logic_filt_2)  # -> report, shades; plug-in component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
model_2 = HBModel(shades=flatten(shade_2.shades), name="Proposed")  # -> report, model; plug-in component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

# ---- group: APSH Ground Model
shade_3 = HBShade(geo=dam_5)  # -> report, shades; plug-in component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
model_3 = HBModel(shades=flatten(shade_3.shades), name="APSH Ground")  # -> report, model; plug-in component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

# ---- group: VSC Window Sensors
units = GhPythonScript(Input_Value="10")  # -> RhinoUnit; inputs Input_Value: Int32; same code as units
quad_mesh = BooleanToggle(False)
genpts = LBGeneratePointGrid(geometry=dam_2, grid_size="100000", offset_dist=units, quad_only=quad_mesh)  # -> points, vectors, face_areas, mesh; plug-in component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
sensorgrid = HBSensorGrid(positions=genpts.points, mesh=genpts.mesh)  # -> grid; plug-in component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

# ---- group: APSH Window Sensors
units_2 = GhPythonScript(Input_Value="10")  # -> RhinoUnit; inputs Input_Value: Int32; same code as units
quad_mesh_2 = BooleanToggle(False)
genpts_2 = LBGeneratePointGrid(geometry=dam_3, grid_size="100000", offset_dist=units_2, quad_only=quad_mesh_2)  # -> points, vectors, face_areas, mesh; plug-in component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
sensorgrid_2 = HBSensorGrid(positions=genpts_2.points, mesh=genpts_2.mesh)  # -> grid; plug-in component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

# ---- group: APSH Probable Hours Sensors
z_vector = ZVector()
move = Move(Geometry=dam_5, Motion=z_vector)  # -> Geometry, Transform
genpts_3 = LBGeneratePointGrid(geometry=move.Geometry, grid_size="1000000")  # -> points, vectors, face_areas, mesh; plug-in component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
sensorgrid_3 = HBSensorGrid(positions=genpts_3.points, mesh=genpts_3.mesh)  # -> grid; plug-in component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

# ---- group: VSC/PIT Baseline
assigngridsviews = HBAssignGridsAndViews(model=model.model, grids=flatten(sensorgrid), views=flatten(view))  # -> model; plug-in component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

# ---- group: VSC/PIT Proposed
assigngridsviews_2 = HBAssignGridsAndViews(model=model_2.model, grids=flatten(sensorgrid), views=flatten(view))  # -> model; plug-in component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

# ---- group: APSH Baseline
assigngridsviews_3 = HBAssignGridsAndViews(model=model.model, grids=flatten(sensorgrid_2))  # -> model; plug-in component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

# ---- group: APSH Proposed
assigngridsviews_4 = HBAssignGridsAndViews(model=model_2.model, grids=flatten(sensorgrid_2))  # -> model; plug-in component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

# ---- group: APSH Probable Hours
assigngridsviews_5 = HBAssignGridsAndViews(model=model_3.model, grids=flatten(sensorgrid_3))  # -> model; plug-in component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

# ----
run_vsc_analysis = BooleanToggle(False)
run_apsh = BooleanToggle(False)
run_wpsh = BooleanToggle(False)
# 3
run_pit_render = BooleanToggle(False)

# ---- group: PIT Image / CIE 10,000 Lux Sky
certainillum = HBCertainIlluminance()  # -> sky; plug-in component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

# ---- group: APSH Probable Hours
directsunhours = HBDirectSunHours(
    model=assigngridsviews_5,
    wea=wea,
    north=setnorth,
    run_settings=edit_cluster_for_manual_filepath.settings_4,
    run=run_apsh)  # -> report, results, hours; plug-in component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

# ---- group: APSH Baseline Model
directsunhours_2 = HBDirectSunHours(
    model=assigngridsviews_3,
    wea=wea,
    north=setnorth,
    run_settings=edit_cluster_for_manual_filepath.settings_5,
    run=run_apsh)  # -> report, results, hours; plug-in component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

# ---- group: APSH Proposed Model
directsunhours_3 = HBDirectSunHours(
    model=assigngridsviews_4,
    wea=wea,
    north=setnorth,
    run_settings=edit_cluster_for_manual_filepath.settings_6,
    run=run_apsh)  # -> report, results, hours; plug-in component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

# ---- group: WPSH Probable Hours
directsunhours_4 = HBDirectSunHours(
    model=assigngridsviews_5,
    wea=wea_2,
    north=setnorth,
    run_settings=edit_cluster_for_manual_filepath.settings_7,
    run=run_wpsh)  # -> report, results, hours; plug-in component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

# ---- group: WPSH Baseline Model
directsunhours_5 = HBDirectSunHours(
    model=assigngridsviews_3,
    wea=wea_2,
    north=setnorth,
    run_settings=edit_cluster_for_manual_filepath.settings_8,
    run=run_wpsh)  # -> report, results, hours; plug-in component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

# ---- group: WPSH Proposed Model
directsunhours_6 = HBDirectSunHours(
    model=assigngridsviews_4,
    wea=wea_2,
    north=setnorth,
    run_settings=edit_cluster_for_manual_filepath.settings_9,
    run=run_wpsh)  # -> report, results, hours; plug-in component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

# ---- group: PIT Image
# False Color or Regular HDR
type_of_image = ValueList({"False Colour": 1, "Regular HDR": 0}, selected="Regular HDR")

# PIT Rendered Image
filter_2 = StreamFilter(Gate=render_model, Stream0=assigngridsviews, Stream1=assigngridsviews_2, Stream2=0)
pitview = HBPointInTimeViewBased(
    model=filter_2,
    sky=certainillum,
    resolution=3200,
    radiance_par=radpar,
    run_settings=edit_cluster_for_manual_filepath.settings_3,
    run=run_pit_render)  # -> report, results; plug-in component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
color_scheme = ValueList({"Default": 0, "Pm3d": 1, "Spectral Mapping": 2, "Thermal(Hot)": 3}, selected="Default")
gate = StreamGate(Stream=pitview.results, Gate=type_of_image)  # -> Target0, Target1
falsecolor = HBFalseColor(hdr=gate.Target1, contour_lines=False, color_palette=color_scheme)  # -> hdr; plug-in component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
filter_3 = StreamFilter(Gate=type_of_image, Stream0=gate.Target0, Stream1=falsecolor)
adjusthdr = HBAdjustHDR(hdr=filter_3, adj_expos=Toggle(True))  # -> hdr; plug-in component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
dam_6 = DataDam(DataHDRIm=adjusthdr, BufferDelay=10000000, BufferMode=0)
hdr_gif = HBHDRToGIF(hdr=dam_6)  # -> gif; plug-in component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
imageviewer = LBImageViewer(ImagePath_=dam_6, _scale_=1, DisableClickable=False, SaveImgWithCoords=False, scale=1)  # -> ImagePath, Values, GIF
panel_5 = Panel(hdr_gif)

# ----
# APSH Results
# Select Results to show
preview_results = ValueList({"Baseline APSH": 0, "Proposed APSH": 1, "% difference": 2}, selected="% difference")
results = GhPythonScript(Probable=directsunhours.hours, Existing=directsunhours_2.hours, Proposed=directsunhours_3.hours)  # -> out, APSH_Ex, APSH_Pr, difference; inputs Existing: list, Proposed: list
# ---------- results: Python ----------
"""Rounds values.
    Inputs:
        x: Simulation Data
        y: Integer for existing, proposed or both
    Output:
        a: Formatted results"""

__author__ = "sa.singh"
__version__ = "2024.08.24"

import rhinoscriptsyntax as rs


def list_division(x,y):
    divided = []
    for i in x:
        divided.append("{:.0f}%".format((int(x[i])/int(y[i]))*100))
    return divided

#def format_values(x):
#    formatted_list = []
#    for i in x:
#        formatted_list.append("{:.0f}%".format(x[i]*100)
#    return formatted_list

#round_existing = process_list(Existing)
round_existing = [round(val,1) for val in Existing]
round_proposed = [round(val,1) for val in Proposed]
round_probable = round(Probable,1)

apsh_existing = [x/round_probable for x in round_existing]
apsh_proposed = [x/round_probable for x in round_proposed]

APSH_Ex = apsh_existing

print(type(apsh_proposed[0]))
print(type(round_proposed[0]))

difference = [round((apsh_proposed[i] / apsh_existing[i]),2) for i in range(len(apsh_proposed))]


APSH_Ex = ["{:.0f}%".format(x * 100) for x in apsh_existing]
APSH_Pr = ["{:.0f}%".format(x * 100) for x in apsh_proposed]

#print(type(Baseline))
# ---------- end results ----------
filter_4 = StreamFilter(Gate=preview_results, Stream0=results.APSH_Ex, Stream1=results.APSH_Pr, Stream2=results.difference)

# ----
# WPSH Results
# Select Results to show
results_2 = GhPythonScript(Probable=directsunhours_4.hours, Existing=directsunhours_5.hours, Proposed=directsunhours_6.hours)  # -> out, APSH_Ex, APSH_Pr, difference; inputs Existing: list, Proposed: list; same code as results
preview_results_2 = ValueList({"Baseline WPSH": 0, "Proposed WPSH": 1, "% difference": 2}, selected="Proposed WPSH")
filter_5 = StreamFilter(Gate=preview_results_2, Stream0=results_2.APSH_Ex, Stream1=results_2.APSH_Pr, Stream2=results_2.difference)

vsc_points = Data(genpts.points)

# ----
# Save Results - Option 1: Internalise
# Internalise Data Notes: 1. Make a copy of current results (Ctrl C & Ctrl V). Then right click on the copied component and click 'Internalise Data'. This will save the data in the gh file.
current_results = Data(filter_4)

# ----
# Save Results - Option 1: Internalise
# Internalise Data Notes: 1. Make a copy of current results (Ctrl C & Ctrl V). Then right click on the copied component and click 'Internalise Data'. This will save the data in the gh file.
current_results_2 = Data(filter_5)

# ----
# View VSC on Window Surface
# Preview to
# show VSC
apsh_points = Data(genpts_2.points)
tag = TextTag(Location=apsh_points, Text=filter_4, Colour=ColourSwatch(SwatchColor=RGB(0, 0, 0)))

# ----
# View VSC on Window Surface
# Preview to
# show VSC
apsh_points_2 = Data(genpts_2.points)
tag_2 = TextTag(Location=apsh_points_2, Text=filter_5, Colour=ColourSwatch(SwatchColor=RGB(0, 0, 0)))

# ----
# Save Viewport Image
# Save Viewport Image Notes: 1. Ideally create another viewport only for static images.
# 
# 2. SET NEW NAME FOR EACH IMAGE!!
capture_image = BooleanToggle(False)
captureview = LBCaptureView(
    file_name="Image2",
    folder=python_autogenerate_filepath.VSC_Images,
    viewport="Perspective",
    width="3200",
    height="2400",
    transparent=Toggle(True),
    capture=capture_image)  # -> file; plug-in component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
panel_6 = Panel(captureview)

# ---- group: PIT Image
# Miscellanous Processes (Don't touch)
panel_7 = Panel("APSH Windows")
triggr = RemoteDatadamTrigger(
    groupNames=["Baseline Geometry", "Proposed Geometry", "VSC Windows", "Ground Plane (APSH)", panel_7],
    run=update_all_geometry)  # -> out; inputs groupNames: list of String, run: Boolean
# ---------- triggr: C# usings ----------
using System.Linq;
using System.Drawing;
# ---------- triggr: C# ----------
    Component.Description = "This component will remove trigger datadams.\n\n" +
      "to use it, place your datadams in a group, name the group (right click) and insert the\n" +
      "group name in this component. Hit Run to update all the datadams\n\n" +

      "Copyright LINK Arkitektur 2021 Copenhagen";

    Component.Params.Input[0].Name = "groupNames";
    Component.Params.Input[0].Description = "Names of the groups where we placed the datadams.";
    Component.Params.Input[1].AddVolatileData(new GH_Path(0), 0, false);
    Component.Name = "Remote Datadam Trigger";
    Component.NickName = "TriggR";

    Component.Params.Input[1].Description = "Set to true to run";

    if (run)
    {

      foreach (var groupName in groupNames)
      {
        ExpireDams(groupName);
      }
    }
# ---------- triggr: C# additional code ----------
  void ExpireDams(string groupName){


    var groups = GrasshopperDocument.Objects.OfType<Grasshopper.Kernel.Special.GH_Group>();

    var keyGroup = groups.Where(g => g.NickName == groupName);

    foreach (var myGroup in keyGroup)
    {


      var objects = myGroup.Objects();
      foreach (var obj in objects)
      {
        Grasshopper.Kernel.Components.GH_DataDamComponent myDam = obj as Grasshopper.Kernel.Components.GH_DataDamComponent;
        if (myDam != null)
        {
          myDam.ExpireSolution(true);
          Print("Triggered : " + obj.GetType().ToString());
        }
      }

    }




  }
# ---------- end triggr ----------

# ----
# VSC Results
# Select Results to show
boolean_toggle = BooleanToggle(True)
preview_results_3 = ValueList({"Baseline VSC": 0, "Proposed VSC": 1, "% difference": 2}, selected="Baseline VSC")

# ---- group: Baseline Results
skyview = HBSkyView(
    model=assigngridsviews,
    cloudy_sky=boolean_toggle,
    radiance_par=radpar_2,
    run_settings=edit_cluster_for_manual_filepath.settings,
    run=run_vsc_analysis)  # -> report, results; plug-in component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

# ---- group: Proposed Results
skyview_2 = HBSkyView(
    model=assigngridsviews_2,
    cloudy_sky=Toggle(True),
    radiance_par=radpar_2,
    run_settings=edit_cluster_for_manual_filepath.settings_2,
    run=run_vsc_analysis)  # -> report, results; plug-in component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

# ----
results_3 = GhPythonScript(Baseline=skyview.results, Proposed=skyview_2.results)  # -> out, Baseline_r, Proposed_r, Difference; inputs Baseline: list, Proposed: list
# ---------- results_3: Python ----------
"""Rounds values.
    Inputs:
        x: Simulation Data
        y: Integer for existing, proposed or both
    Output:
        a: Formatted results"""

__author__ = "sa.singh"
__version__ = "2024.08.24"

import rhinoscriptsyntax as rs

def process_list(x):
    result = []
    #round 1 decimal place
    result = [round(val,1) for val in x]
    return result
    
def divisionl(x,y):
    divided = []
    for i in range(len(x)):
        divided.append("{:.2f}".format(x[i]/y[i]))
    return divided

Baseline_r = process_list(Baseline)

Proposed_r = process_list(Proposed)

Difference = divisionl(Proposed_r,Baseline_r)

#print(type(Baseline))
# ---------- end results_3 ----------
filter_6 = StreamFilter(Gate=preview_results_3, Stream0=results_3.Baseline_r, Stream1=results_3.Proposed_r, Stream2=results_3.Difference)

# ----
# Save Results - Option 1: Internalise
# Internalise Data Notes: 1. Make a copy of current results (Ctrl C & Ctrl V). Then right click on the copied component and click 'Internalise Data'. This will save the data in the gh file.
current_results_3 = Data(filter_6)

# ----
# View VSC on Window Surface
# Preview to
# show VSC
swatch = ColourSwatch(SwatchColor=RGB(0, 0, 0))
tag_3 = TextTag(Location=vsc_points, Text=filter_6, Colour=swatch)

# ----
# Save Results Option 2: Write CSV File
# Save Viewport Image Notes: 1. Outputs a column with a unique identifier for each window and a corresponding VSC figure
# 
# 2. TBC...
input_file_name = Panel("test1")
vsc_results = Number(flatten(filter_6))
vsc_points_2 = Data(flatten(genpts.points))
pt2num = PointsToNumbers(Points=vsc_points_2, Mask=4)
create_csv = GhPythonScript(
    Points=pt2num,
    VSC_Results=vsc_results,
    Filepath=python_autogenerate_filepath.VSC_CSV,
    Filename=input_file_name,
    Run=Toggle(False))  # -> out, a; inputs Points: list, VSC_Results: list
# ---------- create_csv: Python ----------
__author__ = "sa.singh"
__version__ = "2024.08.18"

import rhinoscriptsyntax as rs

import csv
import os
import hashlib
from datetime import datetime

def generate_unique_id(x, y, z):
    # Create a string from XYZ coordinates using .format()
    coord_string = "{}_{}_{}".format(x, y, z)
    # Generate a hash from the string
    unique_id = hashlib.md5(coord_string.encode()).hexdigest()  # Take the first 8 characters
    return unique_id

def write_vsc_to_csv(points, vsc_values, file_path, file_name):
    # Ensure that the directory exists
    if not os.path.exists(file_path):
        os.makedirs(file_path)
    
    # Full file path
    full_file_path = os.path.join(file_path, file_name + ".csv")
    
    # Check if the file already exists
    if os.path.exists(full_file_path):
        # Append the current timestamp to the file name
        timestamp = datetime.now().strftime("%Y%m%d_%H%M%S")
        full_file_path = os.path.join(file_path, file_name + "_" + timestamp + ".csv")
    
    # Write to CSV
    with open(full_file_path, 'w') as csvfile:
        csvwriter = csv.writer(csvfile)
        
        # Write the header
        csvwriter.writerow(["UniqueID", "VSC (%)"])
        
        # Process the points and VSC values
        for i in range(0, len(points), 3):
            x = points[i]
            y = points[i+1]
            z = points[i+2]
            vsc = vsc_values[i // 3]
            unique_id = generate_unique_id(x, y, z)
            csvwriter.writerow([unique_id, vsc])
    
    return full_file_path

# Inputs
points = Points  # List of XYZ coordinates (assumed as Rhino.Geometry.Point3d objects)
vsc_values = VSC_Results  # List of VSC values (floats or integers)
file_path = str(Filepath)  # File path to save the CSV
file_name = str(Filename)  # File name for the CSV
runset = Run

# Check if inputs are valid
if runset == True and points and vsc_values and file_path and file_name and len(points) % 3 == 0:
    output_file = write_vsc_to_csv(points, vsc_values, file_path, file_name)
    print('Successfully saved results file')

else:
    print("Not Running")
# ---------- end create_csv ----------

# ==== cluster Colors
merge = Merge(
    Data1=ColourSwatch(SwatchColor=RGB(84, 24, 62)),
    Data2=ColourSwatch(SwatchColor=RGB(255, 20, 169)),
    Data3=ColourSwatch(SwatchColor=RGB(54, 135, 86)),
    Data4=ColourSwatch(SwatchColor=RGB(148, 113, 106)),
    Data5=ColourSwatch(SwatchColor=RGB(178, 70, 48)),
    Data6=ColourSwatch(SwatchColor=RGB(235, 185, 94)),
    Data7=ColourSwatch(SwatchColor=RGB(216, 235, 94)),
    Data8=ColourSwatch(SwatchColor=RGB(87, 189, 90)),
    Data9=ColourSwatch(SwatchColor=RGB(105, 125, 84)),
    Data10=ColourSwatch(SwatchColor=RGB(92, 169, 181)),
    Data11=ColourSwatch(SwatchColor=RGB(166, 181, 92)),
    Data12=ColourSwatch(SwatchColor=RGB(137, 92, 181)),
    Data13=ColourSwatch(SwatchColor=RGB(67, 108, 115)),
    Data14=ColourSwatch(SwatchColor=RGB(186, 112, 97)),
    Data15=ColourSwatch(SwatchColor=RGB(92, 94, 181)))
R = ClusterOutput(merge)

# ==== cluster ZVector
units = GhPythonScript(Input_Value="200")  # -> RhinoUnit; inputs Input_Value: Int32
# ---------- units: Python ----------
"""Keeps Input_Value figure constant by converting it to the Current Rhino Model Units.
    Inputs:
        Input_Value: Enter value to keep constant regardless of rhino units (in mm)
    Output:
        RhinoUnit: The outputted value in the current Rhino Units with regards to the input units"""

__author__ = "sa.singh"
__version__ = "2024.08.18"

import rhinoscriptsyntax as rs
import Rhino

# Get the active Rhino document
rhino_doc = Rhino.RhinoDoc.ActiveDoc

# Get the current model unit system
current_units = rhino_doc.ModelUnitSystem

print("Current Model Units are " + str(current_units))

if current_units == Rhino.UnitSystem.Millimeters:
    RhinoUnit = Input_Value
elif current_units == Rhino.UnitSystem.Meters:
    RhinoUnit = Input_Value/1000
else:
    RhinoUnit = None  # Possibly should add a exception error here?

# Checking other units available in the Unitsystem 
#print(dir(Rhino.UnitSystem))
# ---------- end units ----------
Z = UnitZ(Factor=units)
V = ClusterOutput(Z)

# ==== cluster EditClusterForManualFilepath
folder = ClusterInput()
folder_2 = ClusterInput()
folder_3 = ClusterInput()
folder_4 = ClusterInput()
folder_5 = ClusterInput()
folder_6 = ClusterInput()
folder_7 = ClusterInput()
folder_8 = ClusterInput()
folder_9 = ClusterInput()

# ---- group: VSC Baseline
recipesettings = HBRecipeSettings(folder=folder, reload_old=False)  # -> settings; plug-in component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

# ----
settings = ClusterOutput(recipesettings)

# ---- group: VSC Proposed
recipesettings_2 = HBRecipeSettings(folder=folder_3, reload_old=False)  # -> settings; plug-in component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

# ----
settings_2 = ClusterOutput(recipesettings_2)

# ---- group: PIT Render
recipesettings_3 = HBRecipeSettings(folder=folder_2, reload_old=False)  # -> settings; plug-in component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

# ----
settings_3 = ClusterOutput(recipesettings_3)

# ---- group: APSH Probable
recipesettings_4 = HBRecipeSettings(folder=folder_4, reload_old=False)  # -> settings; plug-in component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

# ----
settings_4 = ClusterOutput(recipesettings_4)

# ---- group: APSH Existing
recipesettings_5 = HBRecipeSettings(folder=folder_5, reload_old=False)  # -> settings; plug-in component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

# ----
settings_5 = ClusterOutput(recipesettings_5)

# ---- group: APSH Proposed
recipesettings_6 = HBRecipeSettings(folder=folder_6, reload_old=False)  # -> settings; plug-in component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

# ----
settings_6 = ClusterOutput(recipesettings_6)

# ---- group: WPSH Probable
recipesettings_7 = HBRecipeSettings(folder=folder_7, reload_old=False)  # -> settings; plug-in component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

# ----
settings_7 = ClusterOutput(recipesettings_7)

# ---- group: WPSH Existing
recipesettings_8 = HBRecipeSettings(folder=folder_8, reload_old=False)  # -> settings; plug-in component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

# ----
settings_8 = ClusterOutput(recipesettings_8)

# ---- group: WPSH Proposed
recipesettings_9 = HBRecipeSettings(folder=folder_9, reload_old=False)  # -> settings; plug-in component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

# ----
settings_9 = ClusterOutput(recipesettings_9)
